# Grasshopper definition Room Program.gh (Grasshopper 1.0.7)

# ----
# Copy Room Names Here!
# Copy Room Areas Here!
room_areas_netto = Panel("""10
20
40
20
100""")
gross_area_factor = Panel("1.15")
max_room_dept_axis = Slider(7, range=0..10)
min_room_width = Panel("2")
room_names = Panel("""a
b
c
d
e""")

multiplication = Multiplication(A=room_areas_netto, B=gross_area_factor)
min = Minimum(A=max_room_dept_axis, B=min_room_width)
division = Division(A=multiplication, B=max_room_dept_axis)
result_room_area_brutto = Panel(multiplication)
larger = LargerThan(FirstNumber=division, SecondNumber=min)  # -> LargerThan, OrEqualTo

# ----
# Proportion for Small Room Sides
panel = Panel("3")

dispatch = Dispatch(List=multiplication, DispatchPattern=larger.OrEqualTo)  # -> ListA, ListB
# Small Rooms
division_2 = Division(A=panel, B="4")
multiplication_2 = Multiplication(A=dispatch.ListB, B=division_2)
sqrt = SquareRoot(Value=multiplication_2)
round = Round(Number=sqrt)  # -> Nearest, Floor, Ceiling
division_3 = Division(A=dispatch.ListB, B=round.Nearest)
panel_2 = Panel(round.Nearest)
panel_3 = Panel(division_3)

lng = ListLength(List=multiplication)
repeat = RepeatData(Data=max_room_dept_axis, Length=lng)
lng_2 = ListLength(List=division)
series = Series(Start=0, Step=1, Count=lng_2)
dispatch_2 = Dispatch(List=series, DispatchPattern=larger.OrEqualTo)  # -> ListA, ListB
replace = ReplaceItems(List=division, Item=panel_2, Indices=dispatch_2.ListB, Wrap=False)
replace_2 = ReplaceItems(List=repeat, Item=panel_3, Indices=dispatch_2.ListB, Wrap=False)

# ----
# Rectangle First Side
# Rectangle Second Side
expression = Expression(x=replace, Expression="Format(\"{0:0.00}\", x)")
expression_2 = Expression(x=replace_2, Expression="Format(\"{0:0.00}\", x)")

rectangle = Rectangle(Plane=PlaneXY(0, 0, 0), XSize=expression, YSize=expression_2, Radius=0)  # -> Rectangle, Length

# ----
# Space Between Rectangles
addition = Addition(A=expression, B=Slider(2, range=0..10))
ma = MassAddition(Input=addition)  # -> Result, PartialResults
ins = InsertItems(List=ma.PartialResults, Item=0, Indices=0, Wrap=True)
lng_3 = ListLength(List=ins)
subtraction = Subtraction(A=lng_3, B=2)
dom = ConstructDomain(DomainStart="0", DomainEnd=subtraction)
subset = SubList(List=ins, Domain=dom, Wrap=True)  # -> List, Index
X = UnitX(Factor=subset.List)
move = Move(Geometry=rectangle.Rectangle, Motion=X)  # -> Geometry, Transform
area = Area(Geometry=move.Geometry)  # -> Area, Centroid

panel_4 = Panel(rectangle.Rectangle)
txt = Text(room_names)

# ----
# nametag
# Rectangles to Bake!
crv = Curve(move.Geometry)
tag = TextTag(Location=area.Centroid, Text=txt)
